vi "Antenna Selection.gvi"   [LabVIEW NXG 2.1.0]
inputs:
  "Channel Input": c128[][]
outputs:
  "antenna sorted index": i32[]
uses:
  AFW::Common::Receive Antenna Selection::Selection program::SORT.gvi
diagram:
  Matrix Size(matrix=$"Channel Input") -> (number of rows=w1)
  for (N = w1) (iteration -> i1) {
    Get Sub Matrix(matrix=$"Channel Input", row 1=i1, row N=i1) -> (submatrix=w3)
    Absolute Value(x=w3) -> w4
    Square(x=w4) -> w5
    Add Array Elements(numeric array=w5) -> (sum=w6)
    append w6 to w2
  }
  call "SORT.gvi"(Channel power input=w2) -> (antenna sorted index=w7)
  $"antenna sorted index" <- w7
