vi "SORT.gvi"   [LabVIEW NXG 2.1.0]
inputs:
  "Channel power input": f64[]
outputs:
  "antenna sorted index": i32[]
diagram:
  Sort 1D Array(array=$"Channel power input") -> (sorted array=w1)
  for {
    w2 = each element of w1
    Search 1D Array(1D array=$"Channel power input", element=w2) -> (index of element=w4)
    append w4 to w3
  }
  Reverse 1D Array(array=w3) -> (reversed array=w5)
  $"antenna sorted index" <- w5
