vi "Selection Main Program.gvi"   [LabVIEW NXG 2.1.0]
inputs:
  "Channel Input": c128[][]
  "Receive Antenna Selection?": bool
  "enable antenna number": i32
  "Tx / Rx": bool
  "FPGA Reference": "RRH FPGA Reference.gtype"[]
outputs:
  "Antenna enable index": bool[]
panel controls:
  "Antenna complete?": bool
uses:
  AFW::Common::Receive Antenna Selection::Selection program::Antenna Selection.gvi
  AFW::Common::Receive Antenna Selection::Selection program::U8 to Bool.gvi
diagram:
  Feedback Node(input=w1) -> w2
  case ($"Antenna complete?") {
    frame False {
      w1 = w2
    }
    frame True {
      Array Subset(array=$"Channel Input", length0=8) -> w3
      call "Antenna Selection.gvi"(Channel Input=w3) -> (antenna sorted index=w4)
      call "U8 to Bool.gvi"(Selected Antenna number=$"enable antenna number", Antenna Index=w4) -> (Antenna able index=w1)
    }
  }
  case ($"Receive Antenna Selection?") {
    frame False, Default {
      $"Antenna complete?" <- TRUE
      for {
        w6 = each element of $"FPGA Reference"
        case ($"Tx / Rx") {
          frame False, Default {
            Property Node(instance in=w6, "Tx Ant enable 0"=TRUE, "Tx Ant enable 1"=TRUE)
          }
          frame True {
            Property Node(instance in=w6, "RX Ant enable 0"=TRUE, "RX Ant enable 1"=TRUE)
          }
        }
      }
      w5 = [TRUE, TRUE, TRUE, TRUE, TRUE, TRUE, TRUE, TRUE]
    }
    frame True {
      $"Antenna complete?" <- FALSE
      for (iteration -> i1) {
        w7 = each element of $"FPGA Reference"
        case ($"Tx / Rx") {
          frame False, Default {
            Multiply(i1, 2) -> w8
            Increment(x=w8) -> w9
            Array Index(array=w1) -> (out0[w8]=w10, out1[w9]=w11)
            Property Node(instance in=w7, "Tx Ant enable 0"=w10, "Tx Ant enable 1"=w11)
          }
          frame True {
            Multiply(i1, 2) -> w12
            Increment(x=w12) -> w13
            Array Index(array=w1) -> (out0[w12]=w14, out1[w13]=w15)
            Property Node(instance in=w7, "RX Ant enable 0"=w14, "RX Ant enable 1"=w15)
          }
        }
      }
      w5 = w1
    }
  }
  $"Antenna enable index" <- w5
