vi "U8 to Bool.gvi"   [LabVIEW NXG 2.1.0]
inputs:
  "Selected Antenna number": i32
  "Antenna Index": i32[]
outputs:
  "Antenna able index": bool[]
diagram:
  Array Size(array=$"Antenna Index") -> (size(s)=w1)
  Initialize Array(element=FALSE, size=w1) -> w2
  s1 = w2  # shift register
  for (N = $"Selected Antenna number") (iteration -> i1) {
    Array Index(array=$"Antenna Index") -> (out0[i1]=w3)
    Replace Array Subset(inArray=s1, index=w3, new=TRUE) -> w4
    next s1 = w4
  }
  $"Antenna able index" <- s1
