vi "Genernal Channel Capacity Cal.gvi"   [LabVIEW NXG 2.1.0]
inputs:
  "Selection?": "Selection.gtype" = "2 antennas"
  "ISNR": f64
outputs:
  "Ergodic capacity": f64
types:
  "Selection.gtype" = enum{"2 antennas", "4 antennas", "6 antennas", "8 antennas"}
uses:
  NI::Analysis::LinearAlgebra::Create Special Real Matrix.gvi
  NI::Analysis::LinearAlgebra::Complex A x B.gvi
  NI::Analysis::LinearAlgebra::Complex Determinant.gvi
diagram:
  case ($"Selection?") {
    frame "2 antennas" {
      w1 = [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]
      w2 = 2
    }
    frame "4 antennas" {
      w1 = [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]
      w2 = 4
    }
    frame "6 antennas" {
      w1 = [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]
      w2 = 6
    }
    frame "8 antennas", Default {
      w1 = [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]
      w2 = 8
    }
  }
  Matrix Size(matrix=w1) -> (number of columns=w3)
  Quotient And Remainder(x=w3, y=12) -> (floor(x/y)=w4)
  To Double Precision Complex(number=w1) -> w5
  Array Subset(array=w5, length0=w2) -> w6
  Is Equal(x=f64 default, y=$ISNR) -> w7
  Select(s=w7, t=-30, f=$ISNR) -> w8
  Divide(x=w8, y=10) -> w9
  Power Of 10(x=w9) -> w10
  for (N = w4) (iteration -> i1) {
    call "Create Special Real Matrix.gvi"(矩阵大小=w2, 矩阵类型="Identity"(0)) -> (特殊矩阵=w12)
    Multiply(i1, 12) -> w13
    Array Subset(array=w6, index1=w13, length1=1) -> w14
    Transpose Matrix(matrix=w14) -> (transposed matrix=w15)
    call "Complex A x B.gvi"(矩阵A=w14, 矩阵B=w15) -> (A x B=w16)
    Multiply(w10, w16) -> w17
    Add(w17, w12) -> w18
    call "Complex Determinant.gvi"(矩阵=w18, 矩阵类型="General"(0)) -> (行列式=w19)
    Absolute Value(x=w19) -> w20
    Logarithm Base 2(x=w20) -> w21
    Multiply(1, w21) -> w22
    append w22 to w11
  }
  Add Array Elements(numeric array=w11) -> (sum=w23)
  To Double Precision Float(number=w4) -> w24
  Divide(x=w23, y=w24) -> w25
  $"Ergodic capacity" <- w25
