vi "Instantaneous CCC.gvi"   [LabVIEW NXG 2.1.0]
inputs:
  "Selection?": "Selection.gtype" = "2 antennas"
  "ISNR": f64
  "channel input": c128[][]
outputs:
  "Ergodic capacity": f64
panel indicators:
  "秩": i32
types:
  "Selection.gtype" = enum{"2 antennas", "4 antennas", "6 antennas", "8 antennas"}
uses:
  NI::Analysis::LinearAlgebra::Create Special Real Matrix.gvi
  NI::Analysis::LinearAlgebra::Complex A x B.gvi
  NI::Analysis::LinearAlgebra::Complex Determinant.gvi
  NI::Analysis::LinearAlgebra::Complex Matrix Rank.gvi
diagram:
  case ($"Selection?") {
    frame "2 antennas" {
      w1 = 2
    }
    frame "4 antennas" {
      w1 = 4
    }
    frame "6 antennas" {
      w1 = 6
    }
    frame "8 antennas", Default {
      w1 = 8
    }
  }
  Matrix Size(matrix=$"channel input") -> (number of columns=w2)
  Quotient And Remainder(x=w2, y=12) -> (floor(x/y)=w3)
  Array Subset(array=$"channel input", length0=w1) -> w4
  Is Equal(x=f64 default, y=$ISNR) -> w5
  Select(s=w5, t=-30, f=$ISNR) -> w6
  Divide(x=w6, y=10) -> w7
  Power Of 10(x=w7) -> w8
  for (N = w3) (iteration -> i1) {
    call "Create Special Real Matrix.gvi"(矩阵大小=w1, 矩阵类型="Identity"(0)) -> (特殊矩阵=w10)
    Multiply(i1, 12) -> w11
    Array Subset(array=w4, index1=w11, length1=1) -> w12
    Transpose Matrix(matrix=w12) -> (transposed matrix=w13)
    call "Complex A x B.gvi"(矩阵A=w12, 矩阵B=w13) -> (A x B=w14)
    Multiply(w8, w14) -> w15
    Add(w15, w10) -> w16
    call "Complex Determinant.gvi"(矩阵=w16, 矩阵类型="General"(0)) -> (行列式=w17)
    Absolute Value(x=w17) -> w18
    Logarithm Base 2(x=w18) -> w19
    Multiply(1, w19) -> w20
    call "Complex Matrix Rank.gvi"(矩阵=w14) -> (秩=w21)
    $"秩" <- w21
    append w20 to w9
  }
  Add Array Elements(numeric array=w9) -> (sum=w22)
  To Double Precision Float(number=w3) -> w23
  Divide(x=w22, y=w23) -> w24
  $"Ergodic capacity" <- w24
