vi "Display Trigger.gvi"   [LabVIEW NXG 2.1.0]
inputs:
  "Loop time": u32
  "Trigger interval": u32
outputs:
  "Trigger": bool
diagram:
  Quotient And Remainder(x=$"Loop time", y=$"Trigger interval") -> (x-y*floor(x/y)=w1)
  Is Equal To 0(x=w1) -> w2
  $Trigger <- w2
