vi "Calculation Main program.gvi"   [LabVIEW NXG 2.1.0]
inputs:
  "Channel Input": c128[][]
  "Antenna enable index": bool[] = [FALSE, FALSE, FALSE, FALSE, FALSE, FALSE, FALSE, FALSE]
  "enable antenna number": i32
  "receive antenna selection": bool
  "Instantaneous SNR": f64
outputs:
  "Ergodic Capacity": cluster{"Element 1": f64, "Element 2": f64}
  "Genernal Channel Capacity": f64
  "Instantaneous Channel Capacity": f64
uses:
  AFW::Common::Receive Antenna Selection::Testify Program::Genernal Channel Capacity Cal.gvi
  AFW::Common::Receive Antenna Selection::Testify Program::Instantaneous CCC.gvi
  AFW::Common::Receive Antenna Selection::Testify Program::Channel Processing.gvi
diagram:
  case ($"receive antenna selection") {
    frame False, Default {
      call "Genernal Channel Capacity Cal.gvi"(Selection?="8 antennas", ISNR=$"Instantaneous SNR") -> (Ergodic capacity=w2)
      call "Instantaneous CCC.gvi"(Selection?="8 antennas", channel input=$"Channel Input", ISNR=$"Instantaneous SNR") -> (Ergodic capacity=w3)
      Build Cluster(w2, w3) -> w1
    }
    frame True {
      case ($"enable antenna number") {
        frame 8, Default {
          w4 = "8 antennas"
        }
        frame 2 {
          w4 = "2 antennas"
        }
        frame 4 {
          w4 = "4 antennas"
        }
        frame 6 {
          w4 = "6 antennas"
        }
      }
      call "Genernal Channel Capacity Cal.gvi"(Selection?=w4, ISNR=$"Instantaneous SNR") -> (Ergodic capacity=w2)
      call "Channel Processing.gvi"(channel input=$"Channel Input", able index=$"Antenna enable index", Select Antenna Num=$"enable antenna number") -> (Selected Channel=w5)
      call "Instantaneous CCC.gvi"(Selection?=w4, channel input=w5, ISNR=$"Instantaneous SNR") -> (Ergodic capacity=w3)
      Build Cluster(w2, w3) -> w1
    }
  }
  $"Genernal Channel Capacity" <- w2
  $"Ergodic Capacity" <- w1
  $"Instantaneous Channel Capacity" <- w3
