vi "Channel Gain Calculation.gvi"   [LabVIEW NXG 2.1.0]
inputs:
  "Trigger": bool
  "Instantaneous Channel Capacity": f64
  "Genernal Channel Capacity": f64
outputs:
  "Instantaneous Channel Gain": f64
  "Channel Gain Percent": f64
  "Channel Gain Plot": f64
diagram:
  Feedback Node(initial value=0, input=w1) -> w2
  Feedback Node(initial value=0, input=w3) -> w4
  case ($Trigger) {
    frame False, Default {
      w3 = w4
      w1 = w2
    }
    frame True {
      Subtract(x=$"Instantaneous Channel Capacity", y=$"Genernal Channel Capacity") -> w3
      Divide(x=w3, y=$"Genernal Channel Capacity") -> w5
      Multiply(w5, 100) -> w1
    }
  }
  $"Instantaneous Channel Gain" <- w3
  $"Channel Gain Percent" <- w1
  Subtract(x=$"Instantaneous Channel Capacity", y=$"Genernal Channel Capacity") -> w6
  $"Channel Gain Plot" <- w6
