vi "Channel Processing.gvi"   [LabVIEW NXG 2.1.0]
inputs:
  "channel input": c128[][]
  "able index": bool[]
  "Select Antenna Num": i32
outputs:
  "Selected Channel": c128[][]
diagram:
  for (N = $"Select Antenna Num") (iteration -> i1) {
    Is Equal To 0(x=i1) -> w2
    Feedback Node(initial value=0, input=w3) -> w4
    case (w2) {
      frame False, Default {
        w5 = w4
      }
      frame True {
        w5 = 0
      }
    }
    Search 1D Array(1D array=$"able index", element=TRUE, start index (0)=w5) -> (index of element=w6)
    Increment(x=w6) -> w3
    append w6 to w1
  }
  for {
    w7 = each element of w1
    Array Index(array=$"channel input") -> (out0[w7, _]=w9)
    append w9 to w8
  }
  $"Selected Channel" <- w8
